# Grasshopper definition gh_bake_structural_objects.gh (Grasshopper 0.9.76)

pt = Point(<point referenced from the Rhino model>)
pt_2 = Point(<point referenced from the Rhino model>)
pt_3 = Point(<point referenced from the Rhino model>)
arc = Arc3Pt(PointA=pt, PointB=pt_2, PointC=pt_3)  # -> Arc, Plane, Radius
revsrf = Revolution(Curve=arc.Arc, Axis=Line((0, 0, 0), (0, 0, 10)), Domain=Slider(2.512, range=0..6.283))
t = Slider(0.65, range=0..1)
id = Slider(2026, range=1..10000)
custom_bake = Button()
c_create_sar = CSharpScript(S=revsrf, b=custom_bake, id=id, t=t)  # -> out
# ---------- c_create_sar: C# ----------
    bool flag = Convert.ToBoolean(b);

    if (flag){
      //Make new attribute to assign structural properties
      ObjectAttributes att = new ObjectAttributes();

      //Bake to the right type of object
      if(S is Brep) {  //If a brep, a polysurface or a surface

        att.SetUserString("SOF_OBJ_TYPE", "SAR");          // Set default key for structural surface (always required)
        att.SetUserString("SOF_GRP", "1");
        att.SetUserString("SOF_ID", Convert.ToString(id)); // Set id of structural surface
        att.SetUserString("SOF_T", Convert.ToString(t));   // Set thickness of surface

        RhinoDoc.ActiveDoc.Objects.AddBrep(S as Brep, att);
      }
      else if (S is Curve) {
        // TODO...
      }
    }
# ---------- end c_create_sar ----------
