# Grasshopper definition girder_system.gh (Grasshopper 1.0.7)
# plug-ins: gh_sofistik

radius = Slider(147.2, range=10..1000)
length = Slider(63.2, range=10..200)
half_width = Slider(3, range=1..5)
segments = Slider(11, range=1..50)
neg = Negative(Value=half_width)
cluster_main_arc = ClusterMainArc(x=radius, R=radius, A=length, B=radius)
girder_left = OffsetCurve(Curve=cluster_main_arc, Distance=neg, Plane=PlaneXY(0, 0, 0), Corners=1)
girder_right = OffsetCurve(Curve=cluster_main_arc, Distance=half_width, Plane=PlaneXY(0, 0, 0), Corners=1)
settings = GlobalSettings(
    ColorStructuralElements=ColourSwatch(SwatchColor=RGB(153, 5, 5)),
    ColorLoads=ColourSwatch(SwatchColor=RGB(4, 2, 82)),
    ColorSupports=RGB(255, 0, 0),
    ScaleFactorLoads=Slider(1.796, range=0..2),
    DensityFactorLoads=1,
    ScaleFactorSupports=Slider(4.295, range=0..5),
    DensityFactorSupports=1,
    ScaleFactorForLocalFrame=Slider(1.796, range=0..2),
    DensityFactorForLocalFrame=Slider(0.231, range=0..2),
    ScaleMiscellaneousElements=1,
    ShowInfo=True)
divide = DivideCurve(Curve=girder_right, Count=segments, Kinks=False)  # -> Points, Tangents, Parameters
divide_2 = DivideCurve(Curve=girder_left, Count=segments, Kinks=False)  # -> Points, Tangents, Parameters
end = EndPoints(Curve=[girder_right, girder_left])  # -> Start, End
cross_girders = Line(StartPoint=divide.Points, EndPoint=divide_2.Points)
structural_line = StructuralLine(
    Curve=[girder_right, girder_left],
    Number=1,
    Group=0,
    Section="1",
    DirZ=Vector(0, 0, 0),
    ElementType="Beam",
    ElementSize=0)
structural_line_2 = StructuralLine(Curve=cross_girders, Number=100, Group=0, Section="2", DirZ=Vector(0, 0, 0), ElementType="Beam", ElementSize=0)
structural_point = StructuralPoint(Point=[end.Start, end.End], Number=0, DirX=Vector(0, 0, 0), DirZ=Vector(0, 0, 0), Fixation="PP")
neg_2 = Negative(Value=Slider(1, range=0..10))
Z = UnitZ(Factor=neg_2)
line_load = LineLoad(HostingCurveSln=structural_line_2, LoadCase=1, Force=Z, Moment=Vector(0, 0, 0), HostLocal=False)
panel = Panel("""PROG AQUA
HEAD
NORM DIN EN1992-2004
CONC 1 C 30
SREC 1 H 1000 200
SREC 2 H 500 200
END""")
sofimshc = SOFiMSHC(
    StructuralElements=[structural_line, structural_line_2, structural_point],
    InitSystem=True,
    CreateMesh=True,
    MeshDensity=0,
    IntersectionTolerance=0.01,
    StartIndex=1000,
    GroupDivisor=-1000)
sofiload = SOFiLOAD(Ld=line_load)
ase = AdvancedSolutionEngine(NumberOfThreads=-1)
project = SOFiSTiKProject(SOFiSTiKData=[panel, sofimshc, sofiload, ase], SOF_SILENT_CALC=False, SOF_STREAM_CONTENT=False)

# ==== cluster ClusterMainArc
x = ClusterInput()
neg = Negative(Value=x)
pt = ConstructPoint(XCoordinate=0, YCoordinate=neg, ZCoordinate=0)
A = ClusterInput()
B = ClusterInput()
division = Division(A=A, B=B)
pl = ConstructPlane(Origin=pt, XAxis=Vector(0, 9.746899704, 0), YAxis=Vector(13.4668567, 0, 0))
R = ClusterInput()
arc = Arc(Plane=pl, Radius=R, Angle=division)  # -> Arc, Length
A_2 = ClusterOutput(arc.Arc)
