# Grasshopper definition test_gh_to_dat.gh (Grasshopper 0.9.76)
# plug-ins: gh_to_dat

section_number = Slider(1, range=1..20)
group_number = Slider(1, range=1..20)
section_number_2 = Slider(1, range=1..20)
other_curves = Curve(<curve referenced from the Rhino model>)
some_curves = Curve(<curve referenced from the Rhino model>)
sln = SLN(Curve=some_curves, Group=group_number, Section=section_number_2)
sln_2 = SLN(Curve=other_curves, Group=group_number, Section=section_number)
end = EndPoints(Curve=sln_2)  # -> Start, End
merge = Merge(Data1=end.Start, Data2=end.End)
spt = SPT(Point=merge, LocalX=Vector(0, 0, 0), LocalZ=Vector(0, 0, 0), Fix="PXPYPZ")
panel = Panel("""SYST 3D GDIV -1000 NEGZ
CTRL MESH 1
CTRL HMIN 0.5""")
merge_2 = Merge(Data1=sln, Data2=sln_2, Data3=spt)
panel_2 = Panel("""PROG AQUA
HEAD
NORM DIN EN1992-2004
STEE 1 S 235

PROF 1 IPE 300 mno 1
PROF 2 IPE 400 mno 1
END""")
sofimshc = SOFiMSHC(ControlValues=panel, Geometry=merge_2)
concat = Concatenate(FragmentA=panel_2, FragmentB=sofimshc)
panel_3 = Panel(concat)
